% Simulink data dictionary CruiseControl_Req_dd.sldd

AccelResSw = mpt.Signal(StorageClass="Global", DataType="boolean", Min=0, Max=1)
Brake = mpt.Signal(StorageClass="Global", DataType="boolean", Min=0, Max=1)
CoastSetSw = mpt.Signal(StorageClass="Global", DataType="boolean", Min=0, Max=1)
CruiseOnOff = mpt.Signal(StorageClass="Global", DataType="boolean", Min=0, Max=1)
Speed = mpt.Signal(StorageClass="Global", DataType="uint8", Min=0, Max=160)
engaged = mpt.Signal(StorageClass="Global", DataType="boolean", Min=0, Max=1)
tspeed = mpt.Signal(StorageClass="Global", DataType="uint8", Min=0, Max=160)
holdrate = mpt.Parameter(5, StorageClass="Global", DataType="uint8", Min=1, Max=10)
incdec = mpt.Parameter(1, StorageClass="Global", DataType="uint8", Min=1, Max=2)
maxtspeed = mpt.Parameter(90, StorageClass="Global", DataType="uint8", Min=80, Max=90)
mintspeed = mpt.Parameter(20, StorageClass="Global", DataType="uint8", Min=20, Max=25)
ModelReferencingVisual = Simulink.ConfigSet(StartTime="0", StopTime="2", FixedStep="0.1", Solver="FixedStepDiscrete", ProdHWDeviceType="32-bit Generic", SystemTargetFile="ert.tlc", TargetLang="C")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