# Requirement set SystemReqs (R2019b)

## 1 [SystemReqs] References to SystemReqs.xlsx (Reqs)
Read-only references to Microsoft Excel document.
Comment: There are no changes
Comment: There are no changes
Comment: There are no changes
Comment: There are no changes
Comment: Updated the element with id INTF-1, property description
Comment: Updated the element with id INTF-1, property description
Comment: There are no changes
Comment: There are no changes

### 1.1 [INTF-1] Cruise Control Switches
A hardware switch shall be used that has (3) individual button inputs to:  (1) power on/off (2)  dual function set/decrease speed (3) dual function resume/increase speed

### 1.2 [INTF-2] Vehicle Inputs
Vehicle speed and brake shall be available inputs to the cruise controller

### 1.3 [INTF-3] Cruise Control Status
The instrument cluster shall have a cruise control indicator for:  (1) target speed, and (2) engaged/disengaged

### 1.4 [FUNC-1] Initial engagement
The cruise control shall only be engaged the first time by the "Set/Decrease Speed" input and nothing else

### 1.5 [FUNC-2] Subsequent engagement
The cruise control may be re-engaged either the "Set/Decrease Speed" or the "Resume/Increase Speed" input

### 1.6 [FUNC-3] Set Speed feature
"Set/Decrease Speed" input will engage cruise control and set target speed to current vehicle speed

### 1.7 [FUNC-4] Resume speed feature
"Resume/Increase Speed" input will re-engage cruise control and set target speed to target speed of previous engagement

### 1.8 [FUNC-5] Increase target speed feature
Target speed setting will be increased by the "Resume/Increase Speed" input when the cruise control is engaged

### 1.9 [FUNC-6] Decrease target speed feature
Target speed setting will be decreased by the "Set/Decrease Speed" input when the cruise control is engaged

### 1.10 [SAFE-1] Operate only within a specified speed range
Cruise controller shall use a specified speed range to control the active vehicle speed range and to limit the requested target speed range

### 1.11 [SAFE-2] Braking will return speed control to driver
Pressing the brake will immediately deactivate the cruise controller and return full control to the driver