test file "CruiseControl_PerfectTest"
  coverage: Decision, MCDC, Condition

suite "CruiseControl_Perfect"

  case "MIL and SIL" [equivalence]
    simulation 1:
      model CruiseControl_Perfect, harness CruiseControl_Perfect_TestHarness, mode Normal
    simulation 2:
      model CruiseControl_Perfect, harness CruiseControl_Perfect_TestHarness, mode Software-in-the-Loop (SIL)
    equivalence criteria (2 of 9 signals compared)
      engaged
      tspeed
    iterations:
      Iteration1: SignalBuilderGroup "Disengage_with_Brake", SignalBuilderGroup "Disengage_with_Brake"
      Iteration2: SignalBuilderGroup "Disengage_with_Disable", SignalBuilderGroup "Disengage_with_Disable"
      Iteration3: SignalBuilderGroup "Engagd_Accel_with_AccelRes_Hold", SignalBuilderGroup "Engagd_Accel_with_AccelRes_Hold"
      Iteration4: SignalBuilderGroup "Engagd_Decel_with_CoastSet_Hold", SignalBuilderGroup "Engagd_Decel_with_CoastSet_Hold"
      Iteration5: SignalBuilderGroup "Engage_1st_with_CoastSetSW", SignalBuilderGroup "Engage_1st_with_CoastSetSW"
      Iteration6: SignalBuilderGroup "Engage_AccelResSw_Veh_Spd", SignalBuilderGroup "Engage_AccelResSw_Veh_Spd"
      Iteration7: SignalBuilderGroup "Engage_CoastSetSw_Veh_Spd", SignalBuilderGroup "Engage_CoastSetSw_Veh_Spd"
      Iteration8: SignalBuilderGroup "Engaged_Accel_with_AccelResSW", SignalBuilderGroup "Engaged_Accel_with_AccelResSW"
      Iteration9: SignalBuilderGroup "Engaged_Decel_with_CoastSetSW", SignalBuilderGroup "Engaged_Decel_with_CoastSetSW"
      Iteration10: SignalBuilderGroup "Init_Not_Enable_or_Engaged", SignalBuilderGroup "Init_Not_Enable_or_Engaged"
      Iteration11: SignalBuilderGroup "No_Engage_1st_with_AccelResSW", SignalBuilderGroup "No_Engage_1st_with_AccelResSW"
      Iteration12: SignalBuilderGroup "Not_Engaged_with_Enable", SignalBuilderGroup "Not_Engaged_with_Enable"
      Iteration13: SignalBuilderGroup "Re_Engage_with_AccelResSw", SignalBuilderGroup "Re_Engage_with_AccelResSw"
      Iteration14: SignalBuilderGroup "Re_Engage_with_CoastSetSw", SignalBuilderGroup "Re_Engage_with_CoastSetSw"

  case "MIL" [simulation]
    model CruiseControl_Perfect, harness CruiseControl_Perfect_TestHarness
    iterations:
      Iteration1: SignalBuilderGroup "Disengage_with_Brake"
      Iteration2: SignalBuilderGroup "Disengage_with_Disable"
      Iteration3: SignalBuilderGroup "Engagd_Accel_with_AccelRes_Hold"
      Iteration4: SignalBuilderGroup "Engagd_Decel_with_CoastSet_Hold"
      Iteration5: SignalBuilderGroup "Engage_1st_with_CoastSetSW"
      Iteration6: SignalBuilderGroup "Engage_AccelResSw_Veh_Spd"
      Iteration7: SignalBuilderGroup "Engage_CoastSetSw_Veh_Spd"
      Iteration8: SignalBuilderGroup "Engaged_Accel_with_AccelResSW"
      Iteration9: SignalBuilderGroup "Engaged_Decel_with_CoastSetSW"
      Iteration10: SignalBuilderGroup "Init_Not_Enable_or_Engaged"
      Iteration11: SignalBuilderGroup "No_Engage_1st_with_AccelResSW"
      Iteration12: SignalBuilderGroup "Not_Engaged_with_Enable"
      Iteration13: SignalBuilderGroup "Re_Engage_with_AccelResSw"
      Iteration14: SignalBuilderGroup "Re_Engage_with_CoastSetSw"

suite "TopItOff"

  case "MIL" [baseline]
    model CruiseControl_Perfect, harness CruiseControl_Perfect_TopItOffHarness
    parameter set "CruiseControl_Perfect_sldvdata.mat:1" from CruiseControl_Perfect_sldvdata.mat (off): holdrate = 10  % CruiseControl_Req_dd.sldd
    parameter set "CruiseControl_Perfect_sldvdata.mat:2" from CruiseControl_Perfect_sldvdata.mat (off): holdrate = 10  % CruiseControl_Req_dd.sldd
    parameter set "CruiseControl_Perfect_sldvdata.mat:3" from CruiseControl_Perfect_sldvdata.mat (off): holdrate = 10  % CruiseControl_Req_dd.sldd
    parameter set "CruiseControl_Perfect_sldvdata.mat:4" from CruiseControl_Perfect_sldvdata.mat (off): holdrate = 10  % CruiseControl_Req_dd.sldd
    parameter set "CruiseControl_Perfect_sldvdata.mat:5" from CruiseControl_Perfect_sldvdata.mat (off): holdrate = 10  % CruiseControl_Req_dd.sldd
    parameter set "CruiseControl_Perfect_sldvdata.mat:6" from CruiseControl_Perfect_sldvdata.mat (off): holdrate = 10  % CruiseControl_Req_dd.sldd
    parameter set "CruiseControl_Perfect_sldvdata.mat:7" from CruiseControl_Perfect_sldvdata.mat (off): holdrate = 10  % CruiseControl_Req_dd.sldd
    parameter set "CruiseControl_Perfect_sldvdata.mat:8" from CruiseControl_Perfect_sldvdata.mat: holdrate = 10  % CruiseControl_Req_dd.sldd
    input "Test Case:1 (1)" from CruiseControl_Perfect_sldvdata.mat (active)
    input "Test Case:2 (1)" from CruiseControl_Perfect_sldvdata.mat
    input "Test Case:3 (1)" from CruiseControl_Perfect_sldvdata.mat
    input "Test Case:4 (1)" from CruiseControl_Perfect_sldvdata.mat
    input "Test Case:5 (1)" from CruiseControl_Perfect_sldvdata.mat
    input "Test Case:6 (1)" from CruiseControl_Perfect_sldvdata.mat
    input "Test Case:7 (1)" from CruiseControl_Perfect_sldvdata.mat
    input "Test Case:8 (1)" from CruiseControl_Perfect_sldvdata.mat
    input "Design Verifier (CruiseControl_Perfect_sldvdata.mat)" from CruiseControl_Perfect_sldvdata.mat
    iterations:
      Iteration1: ExternalInput "Test Case:1 (1)", ParameterSet "CruiseControl_Perfect_sldvdata.mat:1"
      Iteration2: ExternalInput "Test Case:2 (1)", ParameterSet "CruiseControl_Perfect_sldvdata.mat:2"
      Iteration3: ExternalInput "Test Case:3 (1)", ParameterSet "CruiseControl_Perfect_sldvdata.mat:3"
      Iteration4: ExternalInput "Test Case:4 (1)", ParameterSet "CruiseControl_Perfect_sldvdata.mat:4"
      Iteration5: ExternalInput "Test Case:5 (1)", ParameterSet "CruiseControl_Perfect_sldvdata.mat:5"
      Iteration6: ExternalInput "Test Case:6 (1)", ParameterSet "CruiseControl_Perfect_sldvdata.mat:6"
      Iteration7: ExternalInput "Test Case:7 (1)", ParameterSet "CruiseControl_Perfect_sldvdata.mat:7"
      Iteration8: ExternalInput "Test Case:8 (1)", ParameterSet "CruiseControl_Perfect_sldvdata.mat:8"

  case "MIL and SIL" [equivalence]
    simulation 1:
      model CruiseControl_Perfect, harness CruiseControl_Perfect_TopItOffHarness, mode Normal
      parameter set "CruiseControl_Perfect_sldvdata.mat:1" from CruiseControl_Perfect_sldvdata.mat (off): holdrate = 10  % CruiseControl_Req_dd.sldd
      parameter set "CruiseControl_Perfect_sldvdata.mat:2" from CruiseControl_Perfect_sldvdata.mat (off): holdrate = 10  % CruiseControl_Req_dd.sldd
      parameter set "CruiseControl_Perfect_sldvdata.mat:3" from CruiseControl_Perfect_sldvdata.mat (off): holdrate = 10  % CruiseControl_Req_dd.sldd
      parameter set "CruiseControl_Perfect_sldvdata.mat:4" from CruiseControl_Perfect_sldvdata.mat (off): holdrate = 10  % CruiseControl_Req_dd.sldd
      parameter set "CruiseControl_Perfect_sldvdata.mat:5" from CruiseControl_Perfect_sldvdata.mat (off): holdrate = 10  % CruiseControl_Req_dd.sldd
      parameter set "CruiseControl_Perfect_sldvdata.mat:6" from CruiseControl_Perfect_sldvdata.mat (off): holdrate = 10  % CruiseControl_Req_dd.sldd
      parameter set "CruiseControl_Perfect_sldvdata.mat:7" from CruiseControl_Perfect_sldvdata.mat (off): holdrate = 10  % CruiseControl_Req_dd.sldd
      parameter set "CruiseControl_Perfect_sldvdata.mat:8" from CruiseControl_Perfect_sldvdata.mat: holdrate = 10  % CruiseControl_Req_dd.sldd
      input "Test Case:1 (1)" from CruiseControl_Perfect_sldvdata.mat (active)
      input "Test Case:2 (1)" from CruiseControl_Perfect_sldvdata.mat
      input "Test Case:3 (1)" from CruiseControl_Perfect_sldvdata.mat
      input "Test Case:4 (1)" from CruiseControl_Perfect_sldvdata.mat
      input "Test Case:5 (1)" from CruiseControl_Perfect_sldvdata.mat
      input "Test Case:6 (1)" from CruiseControl_Perfect_sldvdata.mat
      input "Test Case:7 (1)" from CruiseControl_Perfect_sldvdata.mat
      input "Test Case:8 (1)" from CruiseControl_Perfect_sldvdata.mat
      input "Design Verifier (CruiseControl_Perfect_sldvdata.mat)" from CruiseControl_Perfect_sldvdata.mat
    simulation 2:
      model CruiseControl_Perfect, harness CruiseControl_Perfect_TopItOffHarness, mode Software-in-the-Loop (SIL)
      parameter set "CruiseControl_Perfect_sldvdata.mat:1" from CruiseControl_Perfect_sldvdata.mat (off): holdrate = 10  % CruiseControl_Req_dd.sldd
      parameter set "CruiseControl_Perfect_sldvdata.mat:2" from CruiseControl_Perfect_sldvdata.mat (off): holdrate = 10  % CruiseControl_Req_dd.sldd
      parameter set "CruiseControl_Perfect_sldvdata.mat:3" from CruiseControl_Perfect_sldvdata.mat (off): holdrate = 10  % CruiseControl_Req_dd.sldd
      parameter set "CruiseControl_Perfect_sldvdata.mat:4" from CruiseControl_Perfect_sldvdata.mat (off): holdrate = 10  % CruiseControl_Req_dd.sldd
      parameter set "CruiseControl_Perfect_sldvdata.mat:5" from CruiseControl_Perfect_sldvdata.mat (off): holdrate = 10  % CruiseControl_Req_dd.sldd
      parameter set "CruiseControl_Perfect_sldvdata.mat:6" from CruiseControl_Perfect_sldvdata.mat (off): holdrate = 10  % CruiseControl_Req_dd.sldd
      parameter set "CruiseControl_Perfect_sldvdata.mat:7" from CruiseControl_Perfect_sldvdata.mat (off): holdrate = 10  % CruiseControl_Req_dd.sldd
      parameter set "CruiseControl_Perfect_sldvdata.mat:8" from CruiseControl_Perfect_sldvdata.mat: holdrate = 10  % CruiseControl_Req_dd.sldd
      input "Test Case:1 (1)" from CruiseControl_Perfect_sldvdata.mat (active)
      input "Test Case:2 (1)" from CruiseControl_Perfect_sldvdata.mat
      input "Test Case:3 (1)" from CruiseControl_Perfect_sldvdata.mat
      input "Test Case:4 (1)" from CruiseControl_Perfect_sldvdata.mat
      input "Test Case:5 (1)" from CruiseControl_Perfect_sldvdata.mat
      input "Test Case:6 (1)" from CruiseControl_Perfect_sldvdata.mat
      input "Test Case:7 (1)" from CruiseControl_Perfect_sldvdata.mat
      input "Test Case:8 (1)" from CruiseControl_Perfect_sldvdata.mat
      input "Design Verifier (CruiseControl_Perfect_sldvdata.mat)" from CruiseControl_Perfect_sldvdata.mat
    equivalence criteria
      engaged
      tspeed
    iterations:
      Iteration1: ExternalInput "Test Case:1 (1)", ParameterSet "CruiseControl_Perfect_sldvdata.mat:1", ExternalInput "Test Case:1 (1)", ParameterSet "CruiseControl_Perfect_sldvdata.mat:1"
      Iteration2: ExternalInput "Test Case:2 (1)", ParameterSet "CruiseControl_Perfect_sldvdata.mat:2", ExternalInput "Test Case:2 (1)", ParameterSet "CruiseControl_Perfect_sldvdata.mat:2"
      Iteration3: ExternalInput "Test Case:3 (1)", ParameterSet "CruiseControl_Perfect_sldvdata.mat:3", ExternalInput "Test Case:3 (1)", ParameterSet "CruiseControl_Perfect_sldvdata.mat:3"
      Iteration4: ExternalInput "Test Case:4 (1)", ParameterSet "CruiseControl_Perfect_sldvdata.mat:4", ExternalInput "Test Case:4 (1)", ParameterSet "CruiseControl_Perfect_sldvdata.mat:4"
      Iteration5: ExternalInput "Test Case:5 (1)", ParameterSet "CruiseControl_Perfect_sldvdata.mat:5", ExternalInput "Test Case:5 (1)", ParameterSet "CruiseControl_Perfect_sldvdata.mat:5"
      Iteration6: ExternalInput "Test Case:6 (1)", ParameterSet "CruiseControl_Perfect_sldvdata.mat:6", ExternalInput "Test Case:6 (1)", ParameterSet "CruiseControl_Perfect_sldvdata.mat:6"
      Iteration7: ExternalInput "Test Case:7 (1)", ParameterSet "CruiseControl_Perfect_sldvdata.mat:7", ExternalInput "Test Case:7 (1)", ParameterSet "CruiseControl_Perfect_sldvdata.mat:7"
      Iteration8: ExternalInput "Test Case:8 (1)", ParameterSet "CruiseControl_Perfect_sldvdata.mat:8", ExternalInput "Test Case:8 (1)", ParameterSet "CruiseControl_Perfect_sldvdata.mat:8"