test file "CruiseControl_TestCase"
  coverage: Decision, MCDC, Condition

suite "TestSuite"

  case "Init Not Enable or Engaged" [simulation]
    model CruiseControl_Req, harness CruiseControl_TestHarness
    signal scenario: Init_Not_Enable_or_Engaged (CruiseControl_TestHarness/Signal Builder)

  case "Not Engaged with Enable" [simulation]
    model CruiseControl_Req, harness CruiseControl_TestHarness
    signal scenario: Not_Engaged_with_Enable (CruiseControl_TestHarness/Signal Builder)

  case "Disengage with Disable" [simulation]
    model CruiseControl_Req, harness CruiseControl_TestHarness
    signal scenario: Disengage_with_Disable (CruiseControl_TestHarness/Signal Builder)

  case "Engage 1st with CoastSetSW" [simulation]
    model CruiseControl_Req, harness CruiseControl_TestHarness
    signal scenario: Engage_1st_with_CoastSetSW (CruiseControl_TestHarness/Signal Builder)

  case "No Engage 1st with AccelResSW" [simulation]
    model CruiseControl_Req, harness CruiseControl_TestHarness
    signal scenario: No_Engage_1st_with_AccelResSW (CruiseControl_TestHarness/Signal Builder)

  case "Disengage with Brake" [simulation]
    model CruiseControl_Req, harness CruiseControl_TestHarness
    signal scenario: Disengage_with_Brake (CruiseControl_TestHarness/Signal Builder)

  case "Re-Engage with CoastSetSw" [simulation]
    model CruiseControl_Req, harness CruiseControl_TestHarness
    signal scenario: Re_Engage_with_CoastSetSw (CruiseControl_TestHarness/Signal Builder)

  case "Re-Engage with AccelResSw" [simulation]
    model CruiseControl_Req, harness CruiseControl_TestHarness
    signal scenario: Re_Engage_with_AccelResSw (CruiseControl_TestHarness/Signal Builder)

  case "Engaged Decel with CoastSetSW" [simulation]
    model CruiseControl_Req, harness CruiseControl_TestHarness
    signal scenario: Engaged_Decel_with_CoastSetSW (CruiseControl_TestHarness/Signal Builder)

  case "Engaged Accel with AccelResSW" [simulation]
    model CruiseControl_Req, harness CruiseControl_TestHarness
    signal scenario: Engaged_Accel_with_AccelResSW (CruiseControl_TestHarness/Signal Builder)

  case "Engagd Decel with CoastSet Hold" [simulation]
    model CruiseControl_Req, harness CruiseControl_TestHarness
    signal scenario: Engagd_Decel_with_CoastSet_Hold (CruiseControl_TestHarness/Signal Builder)

  case "Engagd Accel with AccelRes Hold" [simulation]
    model CruiseControl_Req, harness CruiseControl_TestHarness
    signal scenario: Engagd_Accel_with_AccelRes_Hold (CruiseControl_TestHarness/Signal Builder)

  case "Engage CoastSetSw Veh Spd" [simulation]
    model CruiseControl_Req, harness CruiseControl_TestHarness
    signal scenario: Engage_CoastSetSw_Veh_Spd (CruiseControl_TestHarness/Signal Builder)

  case "Engage AccelResSw Veh Spd" [simulation]
    model CruiseControl_Req, harness CruiseControl_TestHarness
    signal scenario: Engage_AccelResSw_Veh_Spd (CruiseControl_TestHarness/Signal Builder)

suite "EquivalenceTest"

  case "MIL and SIL" [equivalence]
    simulation 1:
      model CruiseControl_Req, harness CruiseControl_TestHarness
    simulation 2:
      model CruiseControl_Req, harness CruiseControl_TestHarness, mode Software-in-the-Loop (SIL)
    equivalence criteria (2 of 9 signals compared)
      engaged
      tspeed